# Grasshopper definition example.gh (Grasshopper 1.0.7)
# plug-ins: GH_CONTAM

# ----
# Define target contaminant(s)
# (or select from system db)
species = Species({"CO": 0, "CO2": 1, "IV1": 2, "NO2": 3, "Ozone": 4, "PM2.5": 5, "SO2": 6}, selected="PM2.5")
lib = Library(
    Options=species,
    Ctm_unit_MDP_0=False,
    Ctm_unit_MDP_10=False,
    Ctm_unit_MDP_11=False,
    Ctm_unit_MDP_12=False,
    Ctm_unit_MDP_13=False,
    Ctm_unit_MDP_14=False,
    Ctm_unit_MDP_15=False,
    Ctm_unit_MDP_1=False,
    Ctm_unit_MDP_2=False,
    Ctm_unit_MDP_3=False,
    Ctm_unit_MDP_4=False,
    Ctm_unit_MDP_5=False,
    Ctm_unit_MDP_6=False,
    Ctm_unit_MDP_7=True,
    Ctm_unit_MDP_8=False,
    Ctm_unit_MDP_9=False,
    Ctm_unit_MD_0=False,
    Ctm_unit_MD_10=False,
    Ctm_unit_MD_11=False,
    Ctm_unit_MD_1=False,
    Ctm_unit_MD_2=False,
    Ctm_unit_MD_3=False,
    Ctm_unit_MD_4=False,
    Ctm_unit_MD_5=False,
    Ctm_unit_MD_6=False,
    Ctm_unit_MD_7=True,
    Ctm_unit_MD_8=False,
    Ctm_unit_MD_9=False,
    Ctm_unit_MP_0=False,
    Ctm_unit_MP_10=False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)

# ----
# Define start/end dates for ctm/wth files
# (will also be used as sim dates if not specified seperately)
panel = Panel("1/1")

# ----
# Generate ctm file based on data on EPA AQS
# * Please enter your own email and key for using the API (right-click the component -> click "Enter API Key").
# If you don't have a key yet, please apply one from the pop-up window.
# NOTE: This database only works for US cities.
site = Site({"Verizon": 0023, "TAKOMA SCHOOL": 0025, "RIVER TERRACE": 0041, "HAINS POINT PM-2.5 AND IMPROVE SITE ON ROOF OF PARK POLICE BLDG.": 0042, "MCMILLAN  NCore-PAMS": 0043, "Takoma Rec Center": 0050, "Near Road": 0051, "King Greenleaf Rec Center": 0053, "ANY STREET": 1000}, selected="HAINS POINT PM-2.5 AND IMPROVE SITE ON ROOF OF PARK POLICE BLDG.")
county = County({"District of Columbia": 001}, selected="District of Columbia")
state = State({"Alabama": 01, "Alaska": 02, "Arizona": 04, "Arkansas": 05, "California": 06, "Colorado": 08, "Connecticut": 09, "Delaware": 10, "District Of Columbia": 11, "Florida": 12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}, selected="District Of Columbia")
ctm_creator = CTMFileCreator(
    _state=state,
    _county=county,
    _site=site,
    _species=lib,
    StartDate=panel,
    EndDate="1/31",
    Year=2017,
    ctm_file="PM_Jan_DC.ctm",
    api_email="nist.rhino@gmail.com",
    api_key="sandhawk27",
    county_code="001",
    site_code="0042",
    state_code="11")

# ----
# Generate wth file from epw file
panel_2 = Panel("USA_VA_Arlington-Ronald.Reagan.Washington.Natl.AP.724050_TMY3.epw")
day = FirstDayOfTheYear({"Sunday": 0, "Monday": 1, "Tuesday": 2, "Wednesday": 3, "Thursday": 4, "Friday": 5, "Saturday": 6}, selected="Sunday")
wth_tool = WeatherFileCreator(
    EnergyPlusWeatherEPWFile=panel_2,
    StartDate=panel,
    EndDate="1/31",
    FirstDayOfTheYear=day,
    port="3/12",
    port_2="11/5",
    wth_file="Wth_Jan_DC.wth",
    set_DST=False)

# ----
# Create windows
srf = Surface([<surface referenced from the Rhino model> x10])
win = Window(_openings=srf, editAFEDetails=False, menuItemSelected_0=False, operable=False, showPreview=False)

# ----
# Pre-processing
#                                      (Project preparation)
# __________________________________________________
# Create zones
brep = Brep([<brep referenced from the Rhino model> x7])
zone = Zone(
    _zones=brep,
    inputDetailedZone=False,
    menuItemSelected_0=False,
    menuItemSelected_1=False,
    showPreview=False,
    temperatureUnit=2,
    temperatureUnitItemSelected_0=True,
    temperatureUnitItemSelected_1=False)

# ----
# Define weather &
# wind properties
wth_wind = WeatherAndWindProperties(
    RelativeNorth=0,
    HeightOfTheUpwindWallRoofOfTheBuilding=10,
    Altitude=0,
    AmbientTemperature=20,
    AbsolutePressure=101325,
    RelativeHumidity=0,
    WindSpeed=0,
    WindDirection=0,
    DayType=1,
    ContaminantCTMFile=ctm_creator,
    WeatherWTHFile=wth_tool,
    code_unit_temperature=2,
    code_unit_velocities=0,
    showPreview=False,
    temperature_unit_0=True,
    temperature_unit_1=False,
    unit_velocities_0=True,
    unit_velocities_1=False,
    unit_velocities_2=False)

# ----
# Generate prj file
# (select steady or transient sim)
# * If path set is not specified, default paths were set up to
# interior/exterior surfaces.
toggle = BooleanToggle(False)
# Project generation & Simulation
# 
# ___________________________________
project = Project(
    _zones=zone,
    Openings=win,
    ContaminantsSpecies=lib,
    WeatherWindProperties=wth_wind,
    _run=toggle,
    sim_prj_file="example.prj",
    custom_sim_set=False,
    editExtIntFlowPath=False,
    path=0,
    prj_file_path_saved="C:\Users\jns42\OneDrive - NIST\CONTAM\CONTAM-ANT\examples\Example_1\example.prj",
    save_to_new_document=False,
    type=1,
    type_af=0,
    type_mf=0,
    type_path_0=True,
    type_path_1=False,
    type_path_2=False,
    type_selection_0=False,
    type_selection_1=True)

# ----
# Run simulation
# (a SIM file
# will be generated)
toggle_2 = BooleanToggle(False)
sim = Simulation(Project=project, _run=toggle_2, result="example.sim")

# ----
# Post-processing
#                                                                                (Result visualization)
# _______________________________________________________________________________________
# Loop from start date/time to end date/time to realise animations
# * Click the play button above
panel_3 = Panel("1/1 0")
anima = ResultsAnimation(_startDateTime=panel_3, _endDateTime="1/31 24", TimeInterval=60)
trigger = Trigger(Interval=100, TimerInterval=100, Target=arrow)  # disabled
arrow = Arrow(_list=anima)

# ----
# Occupant schedule of the susceptible
# person (receiver)
time_zone = Panel("""0 _zone_2
8 _zone_3
9 ambient
17 _zone_3
18 _zone_5
19 _zone_3
21 _zone_2
24 _zone_2""")
day_sched = DaySchedule(
    _name="occ_day",
    _data=time_zone,
    day_sched_type=2,
    menuItemSelected_0=False,
    menuItemSelected_1=False,
    shapeSelected_0=True,
    shapeSelected_1=False,
    showPreview=False,
    temperatureUnit=2,
    temperatureUnitItemSelected_0=True,
    temperatureUnitItemSelected_1=False,
    type_selection_0=True,
    type_selection_1=False,
    type_selection_2=False,
    viz_zone_name=True)
week_sched = WeekSchedule(_name="occ_week", _weekdays=day_sched, _weekends=day_sched, menuItemSelected_0=False, showPreview=False)

# ----
# Read sim results (in sqlite3 file)
# & generate data for the specified ctm and time
results = Results(_results=sim, DateTime=arrow, _element=lib, time_mode=0)  # -> ValueData, Geometry, TimeSequence

# ----
# Read sim results (in sqlite3 file)
# & generate full ctm data
results_2 = Results(_results=sim, _element=lib, time_mode=5)  # -> ValueData, Geometry, TimeSequence

# ----
# Plot full data
panel_4 = Panel("PM2.5 [ug/m3]")
pt = Point(<point referenced from the Rhino model>)
# Plot
plot = ResultPlots(
    _data=results_2.ValueData,
    _origin=pt,
    TimeSequence=results_2.TimeSequence,
    DataTitle=panel_4,
    csv_path="example_results.csv",
    plot_on_off=1,
    range_mode=1,
    range_selection_0=False,
    range_selection_1=True,
    stack_mode=0,
    stack_selection_0=True,
    stack_selection_1=False,
    text_size=0,
    text_size_selection_0=True,
    text_size_selection_1=False,
    text_size_selection_2=False,
    viz_date_selection_0=False,
    viz_date_selection_1=False,
    viz_date_selection_2=True,
    viz_date_selection_3=False,
    viz_plot_mode=0,
    viz_plot_selection_0=True,
    viz_plot_selection_1=False,
    viz_x_mode=2)

# ----
# Occupant health evaluation
# (Accumulated inhaled
# contaminants during
# the exposure duration)
# Occupant exposure
occ_exposure = OccupancyExposure(
    SimulationResults=sim,
    _species=lib,
    OccupantSchedule=week_sched,
    BreathingRate=0.5,
    ContaminantRemovalEfficiencyThroughPPE=0,
    code_unit_vfr=4,
    exposure_duration=0,
    exposure_duration_selection_0=True,
    exposure_duration_selection_1=False,
    exposure_duration_selection_2=False,
    exposure_type=0,
    exposure_type_selection_0=True,
    exposure_type_selection_1=False,
    result_type=0,
    result_type_selection_0=True,
    result_type_selection_1=False,
    unit_vfr_0=False,
    unit_vfr_1=False,
    unit_vfr_2=False,
    unit_vfr_3=False,
    unit_vfr_4=True,
    unit_vfr_5=False)  # -> InfectionRisk, CtmConcentrationSequence, BreathingRateSequence, PPERemovalEfficiencySequence, LocationSequence, TimeSequence

# ----
# Color gradients for concentrations
panel_5 = Panel("0")
gradient = Gradient(
    LowerLimit=panel_5,
    UpperLimit="35",
    Parameter=results.ValueData,
    stops=[0: RGB(0, 128, 0), 0.5: RGB(255, 255, 0), 1: RGB(255, 0, 0)])

# ----
# Color gradients for the legend
number_slider = Slider(7, range=1..20)
concat = Concatenate(FragmentA=panel_5, FragmentB="35", JoinSeparator=" to ")
range = Range(Domain=concat, Steps=number_slider)
gradient_2 = Gradient(
    LowerLimit=panel_5,
    UpperLimit="35",
    Parameter=range,
    stops=[0: RGB(0, 128, 0), 0.5: RGB(255, 255, 0), 1: RGB(255, 0, 0)])

# ----
# * Format output data for viz
# (here we keep 2 decimals as an example)
format = Format(Format="{0:0.00}", Culture=127, Data0=results.ValueData)

# ----
# * Construct legend title with ctm
# name, unit, and date/time
panel_6 = Panel("PM2.5 [ug/m3]")
concat_2 = Concatenate(FragmentA=panel_6, FragmentB=arrow, JoinSeparator=" ")

# ----
# Legend
# Contour
legend = ResultLegend(_title=concat_2, _color=gradient_2, _text=range)

# ----
# Contour of ctm conc
# * Select this component to enable viz in Rhino
result_viz = ResultVisualization(
    Contour=gradient,
    Texts=format,
    Geometry=results.Geometry,
    Legend=legend,
    text_color=0,
    text_color_selection_0=True,
    text_color_selection_1=False,
    text_color_selection_2=False,
    text_color_selection_3=False,
    text_size=2,
    text_size_selection_0=False,
    text_size_selection_1=False,
    text_size_selection_2=True,
    viz_on_off=1,
    viz_space=False,
    viz_space_selection_0=False,
    viz_space_selection_1=True)
